# Grasshopper definition diffusion-limited-aggregation.gh (Grasshopper 1.0.8)
# plug-ins: PillScript

# ---- group: Set how the aggregate grows
# Diffusion limited aggregation. Particles wander in one at a time and freeze where they first touch the cluster; the branching is not designed anywhere, it follows from an arm being hit before the bay behind it. The script is two files: the walk in Script.cs, the grid that keeps it fast in Aggregate.cs. Open the editor by double-clicking the component.
particles = Slider(1500, range=200..5000)
step = Slider(1, range=0.2..3)
stick = Slider(1.5, range=0.5..4)
seed = Slider(7, range=1..200)
particles_2 = Slider(particles, 0.25, range=0..1)
step_2 = Slider(step, 0.25, range=0..1)
stick_2 = Slider(stick, 0.25, range=0..1)
seed_2 = Slider(seed, 0.25, range=0..1)

# ---- group: Grow the aggregate
particles_3 = Integer(particles_2)
step_3 = Number(step_2)
stick_3 = Number(stick_2)
seed_3 = Integer(seed_2)
c_script = CSharpScript(
    Particles=particles_3,
    Step=step_3,
    Stick=stick_3,
    Seed=seed_3,
    CompileOnLoad=True,
    FileContent=["""/// Diffusion limited aggregation: particles wander in from far away one at a time and freeze
/// where they first touch what is already there. Nobody decides the shape; it falls out of the
/// fact that an arm reaching outwards is hit before the bay behind it ever gets the chance.
public class Script : ScriptBase
{
    public void RunScript(
        [Description("How many particles to send in")] [Default(1500)] int particles,
        [Description("How far a particle moves each step")] [Default(1.0)] double step,
        [Description("How close it must come to freeze")] [Default(1.5)] double stick,
        [Description("The same seed grows the same aggregate")] [Default(7)] int seed,
        out List<Point3d> points,
        out List<double> radii)
    {
        var cluster = new Aggregate(stick);
        cluster.Add(Point3d.Origin);

        var random = new Random(seed);
        var wandered = 0L;

        for (var i = 1; i < Math.Max(particles, 1); i++)
        {
            // Launched just outside what has grown so far, and given up on well beyond it: a
            // particle that has drifted that far is cheaper to replace than to follow home.
            var birth = cluster.Radius + 5 * stick;
            var death = cluster.Radius + 25 * stick;

            var walker = OnCircle(random, birth);

            for (var s = 0; s < 40000; s++)
            {
                wandered++;

                if (cluster.Touches(walker))
                {
                    cluster.Add(walker);
                    break;
                }

                var heading = random.NextDouble() * Math.PI * 2;
                walker.X += Math.Cos(heading) * step;
                walker.Y += Math.Sin(heading) * step;

                if (walker.DistanceTo(Point3d.Origin) > death) walker = OnCircle(random, birth);
            }
        }

        points = cluster.Points;

        // Each particle gets a circle that shrinks as the aggregate grows, so the seed reads as
        // the oldest thing in the picture and the tips as the newest.
        radii = new List<double>();
        for (var i = 0; i < points.Count; i++)
        {
            var age = 1.0 - (double)i / Math.Max(points.Count - 1, 1);
            radii.Add(stick * (0.25 + 0.35 * age));
        }

        Print("{0} particles stuck, {1:N0} steps walked, radius {2:F1}",
            points.Count, wandered, cluster.Radius);
    }

    static Point3d OnCircle(Random random, double radius)
    {
        var angle = random.NextDouble() * Math.PI * 2;
        return new Point3d(Math.Cos(angle) * radius, Math.Sin(angle) * radius, 0);
    }
}""", """// Namespaces every file in this script can use.
global using System;
global using System.Collections;
global using System.Collections.Generic;
global using System.Linq;
global using Rhino;
global using Rhino.Geometry;
global using Grasshopper;
global using Grasshopper.Kernel;
global using Grasshopper.Kernel.Data;
global using Grasshopper.Kernel.Types;
global using PillScript;""", "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", """/// A cluster of stuck particles with a grid laid over it, so a walker only ever compares itself
/// against the handful of particles near where it is standing rather than against every particle
/// stuck so far. Without this the run is quadratic and a few thousand particles take minutes.
public class Aggregate
{
    readonly Dictionary<long, List<Point3d>> _cells = new Dictionary<long, List<Point3d>>();
    readonly double _reach;

    public Aggregate(double reach)
    {
        // One cell per reach means a walker's neighbours are always in the nine cells around it.
        _reach = Math.Max(reach, 1e-6);
    }

    public List<Point3d> Points { get; } = new List<Point3d>();

    /// How far the outermost particle sits from the seed. Walkers are launched beyond it.
    public double Radius { get; private set; }

    public void Add(Point3d point)
    {
        Points.Add(point);
        Radius = Math.Max(Radius, point.DistanceTo(Point3d.Origin));

        var key = Key(Column(point.X), Column(point.Y));

        if (!_cells.TryGetValue(key, out var cell)) _cells[key] = cell = new List<Point3d>();
        cell.Add(point);
    }

    /// True when the point has come within reach of something already stuck.
    public bool Touches(Point3d point)
    {
        var cx = Column(point.X);
        var cy = Column(point.Y);
        var square = _reach * _reach;

        for (var x = cx - 1; x <= cx + 1; x++)
        for (var y = cy - 1; y <= cy + 1; y++)
        {
            if (!_cells.TryGetValue(Key(x, y), out var cell)) continue;

            foreach (var stuck in cell)
            {
                var dx = stuck.X - point.X;
                var dy = stuck.Y - point.Y;

                if (dx * dx + dy * dy <= square) return true;
            }
        }

        return false;
    }

    int Column(double value) => (int)Math.Floor(value / _reach);

    /// Two cell indices in one key, which keeps the dictionary off tuple comparisons.
    static long Key(int x, int y) => ((long)x << 32) ^ (uint)y;
}"""],
    FileName=["Script.cs", "GlobalUsings.cs", "Script.csproj", "Aggregate.cs"])  # -> Out, Points, Radii
radii = Number(c_script.Radii)
points = Point(c_script.Points)

# ---- group: Draw each particle as a circle
points_2 = Point(points)
radii_2 = Number(radii)
circle = CircleCNR(Center=points_2, Normal=Vector(0, 0, 1), Radius=radii_2)
circles = Curve(circle)
